# Dynamo graph Dimension Pipe - Closest Grid REV0.dyn (Dynamo 2.3.1.11775)

code_block = CodeBlock()
# ---------- code_block.designscript (44 lines) ----------
"
import clr
clr.AddReference('RevitAPI')
from Autodesk.Revit.DB import*
clr.AddReference('RevitServices')
from RevitServices.Persistence import DocumentManager
from RevitServices.Transactions import TransactionManager
doc = DocumentManager.Instance.CurrentDBDocument
clr.AddReference('RevitNodes')
import Revit
clr.ImportExtensions(Revit.Elements)
clr.ImportExtensions(Revit.GeometryConversion)

pip = UnwrapElement(IN[0])
grid = UnwrapElement(IN[1])

geomopt = Options()
geomopt.ComputeReferences = True
geomopt.IncludeNonVisibleObjects = True
geomopt.View = doc.ActiveView

ref = []
for i in pip:
	r = (i.get_Geometry(geomopt))
	[ref.append(j.Reference) for j in r if str(j).Contains('Line')]

refg = []
for i in grid:
	r = i.get_Geometry(geomopt)
	[refg.append(j.Reference) for j in r if str(j).Contains('Line')]

dim = []
TransactionManager.Instance.EnsureInTransaction(doc)
for i,j,k in zip(ref,refg,IN[2]):
	refarr = ReferenceArray()
	refarr.Clear()
	refarr.Append(i)
	refarr.Append(j)
	dim.append(doc.Create.NewDimension(doc.ActiveView,k.ToRevitType(),refarr))
TransactionManager.Instance.TransactionTaskDone();

OUT = dim

";
# ----------------------------------------

# group: Select Pipes
select_pipes = DSModelElementsSelection()  # 5 picked in the model; graph input

code_block_2 = CodeBlock(x=select_pipes)
# ---------- code_block_2.designscript (4 lines) ----------
CAT1 = x.GetCategory + "";
BOOL1=String.Contains(CAT1,"Pipes");
FIL = List.FilterByBoolMask(x,BOOL1);
PIPES = FIL["in"];
# ----------------------------------------
code_block_3 = CodeBlock { "Grids"; }
byName = Category.ByName(name=code_block_3)
all_elements_of_category = ElementsOfCategory(Category=byName)
code_block_4 = CodeBlock(pip=code_block_2.PIPES, elem=all_elements_of_category)
# ---------- code_block_4.designscript (32 lines) ----------
pp = pip.GetLocation();
p1 = Line.StartPoint(pp);
p = Point.ByCoordinates(p1.X,p1.Y,0);

e = elem.Curve;

//separate horizontal and vertical grids
sp = e.StartPoint;
ep = e.EndPoint;
m = Math.Abs(sp.Y-ep.Y) > Math.Abs(sp.X-ep.X);
filter = DSCore.List.FilterByBoolMask(e,m);
filterelem = DSCore.List.FilterByBoolMask(elem,m);
XGrids = filter["in"].PullOntoPlane(Plane.XY());
YGrids = filter["out"].PullOntoPlane(Plane.XY());
XGridselem = filterelem["in"];
YGridselem = filterelem["out"];

//Building direction lines for dimensions
xdist = p<1>.DistanceTo(XGrids);
ydist = p<1>.DistanceTo(YGrids);

xi = DSCore.List.FirstItem(SortIndexByValue(xdist)<1>);
yi = DSCore.List.FirstItem(SortIndexByValue(ydist)<1>);

gx = XGridselem[xi];
gy = YGridselem[yi];


cpX = XGrids[xi].ClosestPointTo(p);
lx = Line.ByStartPointEndPoint(p,cpX);
cpY = YGrids[yi].ClosestPointTo(p);
ly = Line.ByStartPointEndPoint(p,cpY);
# ----------------------------------------
python_script_from_string = PythonStringNode(script=code_block, IN[0]=code_block_2.PIPES, IN[1]=code_block_4.gy, IN[2]=code_block_4.ly)
python_script_from_string_2 = PythonStringNode(script=code_block, IN[0]=code_block_2.PIPES, IN[1]=code_block_4.gx, IN[2]=code_block_4.lx)
